# Grasshopper definition 231204_GenScript.gh (Grasshopper 1.0.7)
# plug-ins: RhinoCodePluginGH

# General goal is to go through all the previous precidents and come up with digital tools that can leviate parts of the burden from the student espeacill in area/ co2/ cost estimation but not to help them build the whole house
panel = Panel("Type Selection")
panel_2 = Panel("Boden")
panel_3 = Panel("Fasseden")
panel_4 = Panel("Structur")
panel_5 = Panel("Dach")
panel_6 = Panel("Holz")
panel_7 = Panel("Stahl")
panel_8 = Panel("Beton")
geometry = Geometry([<extrusion referenced from the Rhino model> x12])
line = Line([Line((14117.80317, 6214.431089, 10074.41058), (11478.4397, 2580.961498, 6063.05932)), Line((8662.617309, 4333.3966, 10398.33085), (11478.4397, 2580.961498, 6063.05932)), Line((15899.37437, 1181.677401, 10074.41058), (11478.4397, 2580.961498, 6063.05932)), Line((11478.4397, 2580.961498, 6063.05932), (11478.4397, 2580.961498, 100))])
panel_9 = Panel("Algorithm provider")
script = Script(things=geometry, lines=line)  # -> out, a; inputs things: list of Brep, lines: list
# ---------- script: Python ----------
import Rhino.Geometry as rg

Alg1 = "LengthAlgorithm"
Alg2 = "PackingAlgorithm" 


# LengthAlgorithm Meow
# -------------------------------------------------
# nearest neighbour(the problem of this
# lies in whether you could add things cause 
# you could cut but its not good to add)
# -------------------------------------------------
def find_closest_element(target, lst):
    return min(lst, key=lambda x: abs(x - target))

def find_closest_elements(list_a, list_b):
    return [find_closest_element(target, list_a) for target in list_b]

# List_a should contain UUID of the object 
list_a = [10, 50, 20, 70, 50, 60]
UUID_a = ["a", "b", "c", "d", "e"]
list_b = [12, 72, 69]

result = find_closest_elements(list_a, list_b)

# On what cases are possible to add ? 
for line in lines:
    print(line.Length)
# ---------- end script ----------
panel_10 = Panel("Optimization")
panel_11 = Panel("Visualization")
